vi "Main.gviweb"   [LabVIEW NXG 2.1.0]
panel controls:
  "Run Sequence": bool
  "System": T2 = "INTEL-NUC-1"
  "Simulate Failure": enum{"None", "Keyboard", "Video", "Power"} = "None"
panel indicators:
  "Data Grid": T1[]
types:
  T1 = cluster{"System": string, "Test Program": string, "UUT": string, "Status": string, "Last Updated": string, "Queue": f64}
  T2 = enum{"PXI-ATDEMO-1", "PXI-ATDEMO-2", "PXIe-8840Quad-1", "PXIe-8840Quad-2", "PXIe-8840Quad-3", "INTEL-NUC-1", "INTEL-NUC-2"}
  "DataType.gtype" = enum{"Double", "I32", "String", "Boolean", "U64", "Timestamp"}
  "Client Handle.gtype" = u32
  "Configuration.gtype" = cluster{"Server URL": string, "Session": "Client Handle.gtype"}
  "Tag.gtype" = cluster{"Path": string, "Datatype": "DataType.gtype", "Configuration": "Configuration.gtype"}
uses:
  NI::Skyline::Configuration::Open Configuration.gvi
  WebApp::Get Minion ID.gviweb
  NI::Skyline::TagHTTP::Query Tags.gvi
  NI::Skyline::TagHTTP::Multi Read.gvi
  NI::Skyline::TagHTTP::Read Tag Settings.gvi
  WebApp::Get Prop.gviweb
  WebApp::Active Jobs.gviweb
  NI::Skyline::TagHTTP::Close Tag (Multiple).gvi
diagram:
  w1 = FALSE  # Development
  case (w1) {
    frame False, Default {
      # Set Development boolean to False in order to
      # clear server, username, and password
      # before building and deploying the application
      # to your web server or SystemLink.
      w5 = ""  # Server
      w6 = ""  # Username
      w7 = ""  # Password
      w2 = w7
      w3 = w6
      w4 = w5
    }
    frame True {
      # Set Development boolean to True and
      # change the server, username, and password
      # to match your web server.  Also, ensure that CORS
      # is enabled on your web server before trying to
      # interactively run your application from within NXG.
      w8 = "http://server"  # Server
      w9 = "admin"  # Username
      w10 = "admin"  # Password
      w2 = w10
      w3 = w9
      w4 = w8
    }
  }
  call "Open Configuration.gvi"(server url=w4, username=w3, password=w2) -> (configuration=w11)
  while {
    Wait(time to wait=1000)
    case ($"Run Sequence") {
      frame True {
        Format Into String($System) -> w12
        # Sequence must be some where in the TestStand path like C:\Users\Public\Documents\TestSequences
        call "Get Minion ID.gviweb"(configuration in=w11, hostname=w12) -> (configuration out=w13, id=w14)
        case ($"Simulate Failure") {
          frame "None", Default {
            w15 = "[]"
          }
          frame "Keyboard" {
            w15 = "[\"Keyboard=5\"]"
          }
          frame "Video" {
            w15 = "[\"Video=12\"]"
          }
          frame "Power" {
            w15 = "[\"PowerFail=True\"]"
          }
        }
        w16 = "\"Computer Motherboard Tests.seq\""  # Sequence
        call "Run Sequence.gviweb"(configuration=w13, minion ID=w14, sequence=w16, args=w15)
      }
      frame False {
        call "Query Tags.gvi"(paths=["*TestMonitor*"], configuration=w11) -> (tags=w17, error out=w18)
        call "Multi Read.gvi"(tags in=w17, error in=w18) -> (tags out=w19, tag clusters=w20, error out=w21)
        s1 = "Tag.gtype"[] []  # shift register
        for {
          w22 = each element of w19
          w23 = each element of w20
          call "Read Tag Settings.gvi"(tag in=w22, error in=w21) -> (tag out=w25, properties=w26, error out=w27)
          Build Array[ConcatenateInputs=True](s1, w25) -> w28
          Property Node(instance in=w23) -> ("Value"=w29, "Time Stamp"=w30, "Path"=w31)
          Format Date Time String(time stamp=w30) -> (date/time string=w32)
          call "Get Prop.gviweb"(properties=w26, key="nitmHostname") -> (value=w33)
          call "Get Prop.gviweb"(properties=w26, key="nitmProgramName") -> (value=w34)
          call "Get Prop.gviweb"(properties=w26, key="nitmSerialNumber") -> (value=w35)
          Search Or Split String(search string/char=".", string=w31) -> (substring before match=w36)
          call "Active Jobs.gviweb"(configuration in=w11, minion id=w36) -> (jobs in progress=w37)
          Build Cluster(w33, w34, w35, w29, w32, w37) -> w38
          append w38 to w24
          next s1 = w28
        }
        call "Close Tag (Multiple).gvi"(tags=s1, error in=w27)
        $"Data Grid" <- w24
      }
    }
    stop if FALSE
  }
