vi "Run Sequence.gviweb"   [LabVIEW NXG 2.1.0]
inputs:
  "configuration": "Configuration.gtype"
  "minion ID": string
  "sequence": string = " \\\"C:\\\\Users\\\\Public\\\\Documents\\\\National Instruments\\\\TestStand 2016 (32-bit)\\\\Examples\\\\Demos\\\\Mobile Device Test\\\\Mobile Device Test.seq\\\""
  "args": string
panel indicators:
  "POST Request": string
  "body": string
  "headers": string
types:
  "Client Handle.gtype" = u32
  "Configuration.gtype" = cluster{"Server URL": string, "Session": "Client Handle.gtype"}
uses:
  WebApp::Encode.gviweb
  NI::HTTP::POST Buffer.gvi
diagram:
  Property Node(instance in=$configuration) -> ("Session"=w1, "Server URL"=w2)
  call "Encode.gviweb"(string input=$sequence) -> (string output=w3)
  w4 = "\"\n   ],\n   \"metadata\":{  \n      \"queued\":true\n   },\n   \"fun\":\"niteststand_remote_executor.execute\",\n   \"arg\":["
  Concatenate Strings("{  \n   \"tgt\":[  \n      \"", $"minion ID", w4, w3, ",", $args, "   ]\n}") -> w5
  Concatenate Strings(w2, "/nisysmgmt/v1/systems/managed/jobs") -> w6
  call "POST Buffer.gvi"(client handle=w1, url=w6, buffer=w5) -> (headers=w7, body=w8)
  $headers <- w7
  $body <- w8
  $"POST Request" <- w5
